% Simulink data dictionary fuel_pump_V3_1_20201113_20kHz.sldd

MotorPara_Base_Frq = 666
MotorPara_Base_I = 50
MotorPara_Base_RPM = 12000
MotorPara_Base_V = 28
MotorPara_Ld = 1.287e-5
MotorPara_Lq = 2.052e-5
MotorPara_P = 4
MotorPara_Rs = 0.01638
TDEAD = 150
TPBRD = 3750
TPBRD_HALF = 1875
Ts_1kHz = 0.001
Ts_20KHz = 5.0e-5
Ts_40Hz = 0.025
Ts_50Hz = 0.02
Configuration = Simulink.ConfigSet(StartTime="0", StopTime="0.1", Solver="FixedStepDiscrete", ProdHWDeviceType="Texas Instruments->C2000", SystemTargetFile="ert.tlc", HardwareBoard="TI Delfino F2833x", TargetLang="C")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
MotorPara_Ls = 8.3475e-5
Ts_200Hz = 0.005